% Simulink data dictionary controllerData.sldd

BusPositionVelocity = Simulink.Bus()
  Position: single[2 27000]
  Velocity: double

DroneMass = 0.1
Dx = 1.5
Dy = 1.5
Dz = 2.5
Gravity = 9.81
Ix = 0
Iy = 0
Iz = 0
Nx = 10
Ny = 10
Nz = 14.49471
Px = 6
Py = 6
Pz = 6.5
UAVSampleTime = 0.001

uavGuidanceControlBus = Simulink.Bus()
  Roll: single
  Pitch: single
  YawRate: single
  Thrust: single

uavGuidanceEnvironmentBus = Simulink.Bus()
  Gravity: single

uavGuidanceStateBus = Simulink.Bus()
  WorldPosition: single[3 1]
  WorldVelocity: single[3 1]
  EulerZYX: single[3 1]
  BodyAngularRateRPY: single[3 1]
  Thrust: single